# Grasshopper definition adaptive floor plan - bathroom.gh (Grasshopper 0.9.76)
# plug-ins: Pufferfish

point = Point(Point(0, 0, 0))

unit_y = UnitY(Factor=Slider(5000, range=0..10000))
width = Slider(1000, range=0..10000)
threshold = Slider(4000, range=0..10000)
threshold_2 = Slider(0, range=0..10000)
threshold_3 = Slider(0, range=0..10000)
threshold_4 = Slider(0, range=0..10000)
threshold_5 = Slider(0, range=0..10000)
threshold_6 = Slider(1000, range=0..10000)
width_2 = Slider(1000, range=0..10000)
addition = Addition(A=threshold_2, B=threshold_3)
addition_2 = Addition(A=threshold_4, B=threshold_5)
point_2 = Point(<point referenced from the Rhino model>)
curve = Curve([<curve referenced from the Rhino model> x5])
hor_div = HORDIV(threshold=addition_2, width=threshold_5, switch=Toggle(False), y=Toggle(True))  # -> rectangle_18, rectangle_17
ver_div = VERDIV(threshold=addition, width=threshold_3, flip_locked_box=Toggle(False), y=Toggle(True))  # -> rectangle_13, rectangle_14
addition_3 = Addition(A=threshold_6, B=width_2)
rectangle = Rectangle(hor_div.rectangle_17)
rectangle_2 = Rectangle(hor_div.rectangle_18)
rectangle_3 = Rectangle(ver_div.rectangle_14)
rectangle_4 = Rectangle(ver_div.rectangle_13)
width_3 = Slider(800, range=0..10000)
threshold_7 = Slider(0, range=0..10000)
addition_4 = Addition(A=threshold_7, B=width_3)
point_3 = Point(<point referenced from the Rhino model>)
curve_2 = Curve([<curve referenced from the Rhino model> x5])
curve_3 = Curve([<curve referenced from the Rhino model> x5])
width_4 = Slider(800, range=0..10000)
threshold_8 = Slider(0, range=0..10000)
addition_5 = Addition(A=threshold_8, B=width_4)

threshold_9 = Slider(4828.69, range=0..10000)
threshold_10 = Slider(1448.718, range=0..10000)

# ---- group: Input Rectangle
rectangle_5 = Rectangle(Plane=point, XSize=threshold_9, YSize=threshold_10, Radius=0)  # -> Rectangle, Length

# ----
move = Move(Geometry=rectangle_5.Rectangle, Motion=unit_y)  # -> Geometry, Transform
rectangle_6 = Rectangle(move.Geometry)

# ---- group: AREA TAG
area = Area(Geometry=rectangle_6)  # -> Area, Centroid
concatenate = Concatenate(FragmentA=area.Area, FragmentB="sqm")
text_tag = TextTag(Location=area.Centroid, Text=concatenate)  # disabled

# ---- group: DIMS
deconstuct_rectangle = DeconstuctRectangle(Rectangle=rectangle_6)  # -> BasePlane, XInterval, YInterval
deconstruct_domain = DeconstructDomain(Domain=deconstuct_rectangle.YInterval)  # -> Start, End
deconstruct_domain_2 = DeconstructDomain(Domain=deconstuct_rectangle.XInterval)  # -> Start, End
unit_y_2 = UnitY(Factor=deconstruct_domain.End)
unit_x = UnitX(Factor=deconstruct_domain_2.End)
origin = Point(Point(0, 0, 0))
move_2 = Move(Geometry=origin, Motion=unit_y_2)  # -> Geometry, Transform
move_3 = Move(Geometry=origin, Motion=unit_x)  # -> Geometry, Transform
line = Line(StartPoint=origin, EndPoint=move_2.Geometry)
number_slider = Slider(0.2, range=0..1)
line_2 = Line(StartPoint=origin, EndPoint=move_3.Geometry)
linear_dimension = LinearDimension(Line=line_2, PointA=origin, PointB=unit_x, Text="{0:0.00}", Size=number_slider)  # disabled
linear_dimension_2 = LinearDimension(Line=line, PointA=origin, PointB=unit_y_2, Text="{0:0.00}", Size=number_slider)  # disabled

# ----
ver_div_2 = VERDIV(rectangle=rectangle_6, threshold=threshold, width=width, flip_locked_box=Toggle(False), y=Toggle(False))  # -> rectangle_13, rectangle_14
rectangle_7 = Rectangle(ver_div_2.rectangle_13)
rectangle_8 = Rectangle(ver_div_2.rectangle_14)
area_2 = Area(Geometry=rectangle_8)  # -> Area, Centroid
move_to_point = MoveToPoint(Geometry=curve, PointA=point_2, PointB=area_2.Centroid)  # -> Moved, Vector, Transform
ver_div_3 = VERDIV(rectangle=rectangle_7, threshold=addition_3, width=width_2, flip_locked_box=Toggle(False), y=Toggle(True))  # -> rectangle_13, rectangle_14
rectangle_9 = Rectangle(ver_div_3.rectangle_13)
rectangle_10 = Rectangle(ver_div_3.rectangle_14)
area_3 = Area(Geometry=rectangle_10)  # -> Area, Centroid
ver_div_4 = VERDIV(rectangle=rectangle_9, threshold=addition_4, width=width_3, flip_locked_box=Toggle(False), y=Toggle(True))  # -> rectangle_13, rectangle_14
move_to_point_2 = MoveToPoint(Geometry=curve_2, PointA=point_3, PointB=area_3.Centroid)  # -> Moved, Vector, Transform
rectangle_11 = Rectangle(ver_div_4.rectangle_13)
rectangle_12 = Rectangle(ver_div_4.rectangle_14)
area_4 = Area(Geometry=rectangle_12)  # -> Area, Centroid
move_to_point_3 = MoveToPoint(Geometry=curve_3, PointA=Point(11780.21689, 1090.18387, 0), PointB=area_4.Centroid)  # -> Moved, Vector, Transform
ver_div_5 = VERDIV(rectangle=rectangle_11, threshold=addition_5, width=width_4, flip_locked_box=Toggle(False), y=Toggle(False))  # -> rectangle_13, rectangle_14
rectangle_13 = Rectangle(ver_div_5.rectangle_13)
rectangle_14 = Rectangle(ver_div_5.rectangle_14)
area_5 = Area(Geometry=rectangle_14)  # -> Area, Centroid
point_4 = Point(<point referenced from the Rhino model>)
curve_4 = Curve([<curve referenced from the Rhino model> x9])
move_to_point_4 = MoveToPoint(Geometry=curve_4, PointA=point_4, PointB=area_5.Centroid)  # -> Moved, Vector, Transform

# ==== cluster HORDIV
rectangle = ClusterInput()
threshold = ClusterInput()
y = ClusterInput()
width = ClusterInput()
switch = ClusterInput()
rectangle_2 = Rectangle()
# HORIZONTAL DIVISION
deconstuct_rectangle = DeconstuctRectangle(Rectangle=rectangle)  # -> BasePlane, XInterval, YInterval
deconstuct_rectangle_2 = DeconstuctRectangle(Rectangle=rectangle_2)  # -> BasePlane, XInterval, YInterval
deconstruct_domain = DeconstructDomain(Domain=deconstuct_rectangle.YInterval)  # -> Start, End
deconstruct_domain_2 = DeconstructDomain(Domain=deconstuct_rectangle.XInterval)  # -> Start, End
deconstruct_domain_3 = DeconstructDomain(Domain=deconstuct_rectangle_2.XInterval)  # -> Start, End
deconstruct_domain_4 = DeconstructDomain(Domain=deconstuct_rectangle_2.YInterval)  # -> Start, End
expression = Expression(x=deconstruct_domain.End, threshold=threshold, width=width, Expression="If((threshold<x),width,0)")
deconstuct_rectangle_3 = DeconstuctRectangle()  # -> BasePlane, XInterval, YInterval
number = Number()
boolean = Boolean()
expression_2 = Expression(x=deconstruct_domain_3.End, Expression="If((threshold<x),width,0)")
deconstruct_domain_5 = DeconstructDomain(Domain=deconstuct_rectangle_3.YInterval)  # -> Start, End
deconstruct_domain_6 = DeconstructDomain(Domain=deconstuct_rectangle_3.XInterval)  # -> Start, End
number_2 = Number()
subtraction = Subtraction(A=deconstruct_domain_5.End, B=number)
number_3 = Number(expression)
deconstuct_rectangle_4 = DeconstuctRectangle()  # -> BasePlane, XInterval, YInterval
switch_2 = Boolean(switch)
flip_locked_box = Boolean()
number_4 = Number(expression_2)
subtraction_2 = Subtraction(A=deconstruct_domain.End, B=number_3)
switch_stream = PythonScript(switch=boolean, x=number, y=subtraction)  # -> out, a
# ---------- switch_stream: Python ----------
if switch:
    a = x
else:
    a = y
# ---------- end switch_stream ----------
switch_stream_2 = PythonScript(switch=boolean, x=subtraction, y=number)  # -> out, a; same code as switch_stream
deconstruct_domain_7 = DeconstructDomain(Domain=deconstuct_rectangle_4.XInterval)  # -> Start, End
deconstruct_domain_8 = DeconstructDomain(Domain=deconstuct_rectangle_4.YInterval)  # -> Start, End
subtraction_3 = Subtraction(A=deconstruct_domain_3.End, B=number_4)
panel = Panel(switch_stream_2.a)
panel_2 = Panel(switch_stream.a)
unit_y = UnitY(Factor=number_2)
move = Move(Geometry=deconstuct_rectangle_4.BasePlane, Motion=unit_y)  # -> Geometry, Transform
subtraction_4 = Subtraction(A=deconstruct_domain_8.End, B=number_2)
switch_stream_3 = PythonScript(switch=switch_2, x=subtraction_2, y=number_3)  # -> out, a, b
# ---------- switch_stream_3: Python ----------
if switch:
    a = x
    b = y
else:
    a = y
    b = x
# ---------- end switch_stream_3 ----------
python_script = PythonScript(x=number_3, y=y)  # -> out, a
# ---------- python_script: Python ----------
if y and x==0:
    a = True
else:
    a = False
# ---------- end python_script ----------
switch_stream_4 = PythonScript(switch=flip_locked_box, x=subtraction_3, y=number_4)  # -> out, a, b; same code as switch_stream_3
rectangle_3 = Rectangle(Plane=deconstuct_rectangle_4.BasePlane, XSize=deconstruct_domain_7.End, YSize=number_2, Radius=0)  # -> Rectangle, Length
rectangle_4 = Rectangle(Plane=move.Geometry, XSize=deconstruct_domain_7.End, YSize=subtraction_4, Radius=0)  # -> Rectangle, Length
unit_y_2 = UnitY(Factor=panel_2)
python_script_2 = PythonScript(x=number_4)  # -> out, a; same code as python_script
switch_stream_5 = PythonScript(SwitchSurviver=python_script.a, x=switch_stream_3.a, y=switch_stream_3.b)  # -> out, a, b
# ---------- switch_stream_5: Python ----------
if SwitchSurviver:
    a = x
    b = y
else:
    a = y
    b = x
# ---------- end switch_stream_5 ----------
rectangle_5 = Rectangle(rectangle_3.Rectangle)
rectangle_6 = Rectangle(rectangle_4.Rectangle)
move_2 = Move(Geometry=deconstuct_rectangle_3.BasePlane, Motion=unit_y_2)  # -> Geometry, Transform
panel_3 = Panel(switch_stream_5.b)
panel_4 = Panel(switch_stream_5.a)
unit_y_3 = UnitY(Factor=panel_4)
switch_stream_6 = PythonScript(SwitchSurviver=python_script_2.a, x=switch_stream_4.a, y=switch_stream_4.b)  # -> out, a, b; same code as switch_stream_5
rectangle_7 = Rectangle(Plane=move_2.Geometry, XSize=deconstruct_domain_6.End, YSize=panel, Radius=0)  # -> Rectangle, Length
rectangle_8 = Rectangle(Plane=deconstuct_rectangle_3.BasePlane, XSize=deconstruct_domain_6.End, YSize=panel_2, Radius=0)  # -> Rectangle, Length
unit_x = UnitX(Factor=switch_stream_6.b)
move_3 = Move(Geometry=deconstuct_rectangle.BasePlane, Motion=unit_y_3)  # -> Geometry, Transform
rectangle_9 = Rectangle(rectangle_7.Rectangle)
rectangle_10 = Rectangle(rectangle_8.Rectangle)
move_4 = Move(Geometry=deconstuct_rectangle_2.BasePlane, Motion=unit_x)  # -> Geometry, Transform
panel_5 = Panel(switch_stream_6.a)
panel_6 = Panel(switch_stream_6.b)
rectangle_11 = Rectangle(Plane=move_3.Geometry, XSize=deconstruct_domain_2.End, YSize=panel_3, Radius=0)  # -> Rectangle, Length
rectangle_12 = Rectangle(Plane=deconstuct_rectangle.BasePlane, XSize=deconstruct_domain_2.End, YSize=panel_4, Radius=0)  # -> Rectangle, Length
rectangle_13 = Rectangle(Plane=move_4.Geometry, XSize=switch_stream_6.a, YSize=deconstruct_domain_4.End, Radius=0)  # -> Rectangle, Length
rectangle_14 = Rectangle(Plane=deconstuct_rectangle_2.BasePlane, XSize=switch_stream_6.b, YSize=deconstruct_domain_4.End, Radius=0)  # -> Rectangle, Length
rectangle_15 = Rectangle(rectangle_12.Rectangle)
rectangle_16 = Rectangle(rectangle_11.Rectangle)
rectangle_17 = ClusterOutput(rectangle_15)
rectangle_18 = ClusterOutput(rectangle_16)

# ==== cluster VERDIV
width = ClusterInput()
flip_locked_box = ClusterInput()
y = ClusterInput()
threshold = ClusterInput()
rectangle = ClusterInput()
rectangle_2 = Rectangle(rectangle)
# VERTICAL DIVISION
deconstuct_rectangle = DeconstuctRectangle(Rectangle=rectangle_2)  # -> BasePlane, XInterval, YInterval
deconstuct_rectangle_2 = DeconstuctRectangle()  # -> BasePlane, XInterval, YInterval
boolean = Boolean()
number = Number()
deconstruct_domain = DeconstructDomain(Domain=deconstuct_rectangle.XInterval)  # -> Start, End
deconstruct_domain_2 = DeconstructDomain(Domain=deconstuct_rectangle.YInterval)  # -> Start, End
deconstruct_domain_3 = DeconstructDomain(Domain=deconstuct_rectangle_2.XInterval)  # -> Start, End
deconstruct_domain_4 = DeconstructDomain(Domain=deconstuct_rectangle_2.YInterval)  # -> Start, End
expression = Expression(x=deconstruct_domain.End, threshold=threshold, width=width, Expression="If((threshold<x),width,0)")
number_2 = Number()
subtraction = Subtraction(A=deconstruct_domain_3.End, B=number)
# OLD
deconstuct_rectangle_3 = DeconstuctRectangle()  # -> BasePlane, XInterval, YInterval
switch_stream = PythonScript(switch=boolean, x=subtraction, y=number)  # -> out, a; same code as switch_stream
switch_stream_2 = PythonScript(switch=boolean, x=number, y=subtraction)  # -> out, a; same code as switch_stream
flip_locked_box_2 = Boolean(flip_locked_box)
number_3 = Number(expression)
deconstruct_domain_5 = DeconstructDomain(Domain=deconstuct_rectangle_3.YInterval)  # -> Start, End
panel = Panel(switch_stream.a)
deconstruct_domain_6 = DeconstructDomain(Domain=deconstuct_rectangle_3.XInterval)  # -> Start, End
panel_2 = Panel(switch_stream_2.a)
subtraction_2 = Subtraction(A=deconstruct_domain.End, B=number_3)
subtraction_3 = Subtraction(A=deconstruct_domain_6.End, B=number_2)
unit_x = UnitX(Factor=number_2)
move = Move(Geometry=deconstuct_rectangle_3.BasePlane, Motion=unit_x)  # -> Geometry, Transform
unit_x_2 = UnitX(Factor=panel_2)
switch_stream_3 = PythonScript(switch=flip_locked_box_2, x=subtraction_2, y=number_3)  # -> out, a, b; same code as switch_stream_3
rectangle_3 = Rectangle(Plane=move.Geometry, XSize=subtraction_3, YSize=deconstruct_domain_5.End, Radius=0)  # -> Rectangle, Length
rectangle_4 = Rectangle(Plane=deconstuct_rectangle_3.BasePlane, XSize=number_2, YSize=deconstruct_domain_5.End, Radius=0)  # -> Rectangle, Length
move_2 = Move(Geometry=deconstuct_rectangle_2.BasePlane, Motion=unit_x_2)  # -> Geometry, Transform
python_script = PythonScript(x=number_3, y=y)  # -> out, a; same code as python_script
rectangle_5 = Rectangle(rectangle_3.Rectangle)
rectangle_6 = Rectangle(rectangle_4.Rectangle)
rectangle_7 = Rectangle(Plane=move_2.Geometry, XSize=panel, YSize=deconstruct_domain_4.End, Radius=0)  # -> Rectangle, Length
rectangle_8 = Rectangle(Plane=deconstuct_rectangle_2.BasePlane, XSize=panel_2, YSize=deconstruct_domain_4.End, Radius=0)  # -> Rectangle, Length
switch_stream_4 = PythonScript(SwitchSurviver=python_script.a, x=switch_stream_3.a, y=switch_stream_3.b)  # -> out, a, b; same code as switch_stream_5
rectangle_9 = Rectangle(rectangle_7.Rectangle)
rectangle_10 = Rectangle(rectangle_8.Rectangle)
unit_x_3 = UnitX(Factor=switch_stream_4.b)
move_3 = Move(Geometry=deconstuct_rectangle.BasePlane, Motion=unit_x_3)  # -> Geometry, Transform
panel_3 = Panel(switch_stream_4.a)
panel_4 = Panel(switch_stream_4.b)
rectangle_11 = Rectangle(Plane=move_3.Geometry, XSize=switch_stream_4.a, YSize=deconstruct_domain_2.End, Radius=0)  # -> Rectangle, Length
rectangle_12 = Rectangle(Plane=deconstuct_rectangle.BasePlane, XSize=switch_stream_4.b, YSize=deconstruct_domain_2.End, Radius=0)  # -> Rectangle, Length
rectangle_13 = ClusterOutput(rectangle_11.Rectangle)
rectangle_14 = ClusterOutput(rectangle_12.Rectangle)
