# Grasshopper definition adaptive floor plan - lock survivor.gh (Grasshopper 0.9.76)

# ---- group: REMOTE CONTROLLER
number_slider = Slider(8, range=0..10)
number_slider_2 = Slider(25, range=4..25)

# ----
point = Point(Point(0, 0, 0))

# ---- group: Input Rectangle
rectangle = Rectangle(Plane=point, XSize=number_slider_2, YSize=number_slider, Radius=0)  # -> Rectangle, Length

# ----
rectangle_2 = Rectangle(rectangle.Rectangle)
threshold = Slider(9, range=0..10)
width = Slider(5, range=0..10)

# ---- group: AREA TAG
area = Area(Geometry=rectangle_2)  # -> Area, Centroid
concatenate = Concatenate(FragmentA=area.Area, FragmentB="sqm")
text_tag = TextTag(Location=area.Centroid, Text=concatenate)  # disabled

# ---- group: DIMS
deconstuct_rectangle = DeconstuctRectangle(Rectangle=rectangle_2)  # -> BasePlane, XInterval, YInterval
deconstruct_domain = DeconstructDomain(Domain=deconstuct_rectangle.YInterval)  # -> Start, End
deconstruct_domain_2 = DeconstructDomain(Domain=deconstuct_rectangle.XInterval)  # -> Start, End
unit_y = UnitY(Factor=deconstruct_domain.End)
unit_x = UnitX(Factor=deconstruct_domain_2.End)
origin = Point(Point(0, 0, 0))
move = Move(Geometry=origin, Motion=unit_y)  # -> Geometry, Transform
move_2 = Move(Geometry=origin, Motion=unit_x)  # -> Geometry, Transform
line = Line(StartPoint=origin, EndPoint=move.Geometry)
number_slider_3 = Slider(0.2, range=0..1)
line_2 = Line(StartPoint=origin, EndPoint=move_2.Geometry)
linear_dimension = LinearDimension(Line=line_2, PointA=origin, PointB=unit_x, Text="{0:0.00}", Size=number_slider_3)  # disabled
linear_dimension_2 = LinearDimension(Line=line, PointA=origin, PointB=unit_y, Text="{0:0.00}", Size=number_slider_3)  # disabled

# ----
threshold_2 = Slider(6, range=0..10)
threshold_3 = Slider(1, range=0..10)
addition = Addition(A=threshold, B=width)
width_2 = Slider(4, range=0..10)
width_3 = Slider(3, range=0..10)
ver_div = VERDIV(rectangle=rectangle_2, threshold=addition, width=width, flip_locked_box=Toggle(False), y=Toggle(False))  # -> rectangle_13, rectangle_14
addition_2 = Addition(A=threshold_2, B=width_2)
addition_3 = Addition(A=threshold_3, B=width_3)
threshold_4 = Slider(4, range=0..10)
rectangle_3 = Rectangle(ver_div.rectangle_13)
rectangle_4 = Rectangle(ver_div.rectangle_14)
width_4 = Slider(5, range=0..10)
hor_div = HORDIV(threshold=addition_3, width=width_3, switch=Toggle(False), y=Toggle(True))  # -> rectangle_18, rectangle_17
ver_div_2 = VERDIV(threshold=addition_2, width=width_2, flip_locked_box=Toggle(False), y=Toggle(True))  # -> rectangle_13, rectangle_14
area_2 = Area(Geometry=rectangle_4)  # -> Area, Centroid
addition_4 = Addition(A=threshold_4, B=width_4)
rectangle_5 = Rectangle(hor_div.rectangle_17)
rectangle_6 = Rectangle(hor_div.rectangle_18)
rectangle_7 = Rectangle(ver_div_2.rectangle_13)
rectangle_8 = Rectangle(ver_div_2.rectangle_14)
text_tag_2 = TextTag(Location=area_2.Centroid, Text="Bedroom")
ver_div_3 = VERDIV(rectangle=rectangle_3, threshold=addition_4, width=width_4, flip_locked_box=Toggle(True), y=Toggle(False))  # -> rectangle_13, rectangle_14
threshold_5 = Slider(4, range=0..10)
rectangle_9 = Rectangle(ver_div_3.rectangle_13)
rectangle_10 = Rectangle(ver_div_3.rectangle_14)
width_5 = Slider(5, range=0..10)
area_3 = Area(Geometry=rectangle_9)  # -> Area, Centroid
text_tag_3 = TextTag(Location=area_3.Centroid, Text="Bedroom")
addition_5 = Addition(A=threshold_5, B=width_5)
threshold_6 = Slider(0, range=0..10)
ver_div_4 = VERDIV(rectangle=rectangle_10, threshold=addition_5, width=width_5, flip_locked_box=Toggle(True), y=Toggle(False))  # -> rectangle_13, rectangle_14
width_6 = Slider(1, range=0..10)
rectangle_11 = Rectangle(ver_div_4.rectangle_13)
rectangle_12 = Rectangle(ver_div_4.rectangle_14)
addition_6 = Addition(A=threshold_6, B=width_6)
hor_div_2 = HORDIV(rectangle=rectangle_11, threshold=addition_6, width=width_6, switch=Toggle(True), y=Toggle(True))  # -> rectangle_18, rectangle_17
threshold_7 = Slider(4, range=0..10)
rectangle_13 = Rectangle(hor_div_2.rectangle_17)
rectangle_14 = Rectangle(hor_div_2.rectangle_18)
width_7 = Slider(5, range=0..10)
area_4 = Area(Geometry=rectangle_14)  # -> Area, Centroid
text_tag_4 = TextTag(Location=area_4.Centroid, Text="Bedroom")
addition_7 = Addition(A=threshold_7, B=width_7)
threshold_8 = Slider(0, range=0..10)
ver_div_5 = VERDIV(rectangle=rectangle_12, threshold=addition_7, width=width_7, flip_locked_box=Toggle(True), y=Toggle(False))  # -> rectangle_13, rectangle_14
width_8 = Slider(1, range=0..10)
rectangle_15 = Rectangle(ver_div_5.rectangle_13)
rectangle_16 = Rectangle(ver_div_5.rectangle_14)
addition_8 = Addition(A=threshold_8, B=width_8)
area_5 = Area(Geometry=rectangle_16)  # -> Area, Centroid
hor_div_3 = HORDIV(rectangle=rectangle_15, threshold=addition_8, width=width_8, switch=Toggle(True), y=Toggle(True))  # -> rectangle_18, rectangle_17
text_tag_5 = TextTag(Location=area_5.Centroid, Text="Living")
rectangle_17 = Rectangle(hor_div_3.rectangle_17)
region_union = RegionUnion(Curves=[rectangle_17, rectangle_13, rectangle_16])
rectangle_18 = Rectangle(hor_div_3.rectangle_18)
area_6 = Area(Geometry=rectangle_18)  # -> Area, Centroid
text_tag_6 = TextTag(Location=area_6.Centroid, Text="Bedroom")

# ==== cluster HORDIV
rectangle = ClusterInput()
threshold = ClusterInput()
y = ClusterInput()
width = ClusterInput()
switch = ClusterInput()
rectangle_2 = Rectangle()
# HORIZONTAL DIVISION
deconstuct_rectangle = DeconstuctRectangle(Rectangle=rectangle)  # -> BasePlane, XInterval, YInterval
deconstuct_rectangle_2 = DeconstuctRectangle(Rectangle=rectangle_2)  # -> BasePlane, XInterval, YInterval
deconstruct_domain = DeconstructDomain(Domain=deconstuct_rectangle.YInterval)  # -> Start, End
deconstruct_domain_2 = DeconstructDomain(Domain=deconstuct_rectangle.XInterval)  # -> Start, End
deconstruct_domain_3 = DeconstructDomain(Domain=deconstuct_rectangle_2.XInterval)  # -> Start, End
deconstruct_domain_4 = DeconstructDomain(Domain=deconstuct_rectangle_2.YInterval)  # -> Start, End
expression = Expression(x=deconstruct_domain.End, threshold=threshold, width=width, Expression="If((threshold<x),width,0)")
deconstuct_rectangle_3 = DeconstuctRectangle()  # -> BasePlane, XInterval, YInterval
number = Number()
boolean = Boolean()
expression_2 = Expression(x=deconstruct_domain_3.End, Expression="If((threshold<x),width,0)")
deconstruct_domain_5 = DeconstructDomain(Domain=deconstuct_rectangle_3.YInterval)  # -> Start, End
deconstruct_domain_6 = DeconstructDomain(Domain=deconstuct_rectangle_3.XInterval)  # -> Start, End
number_2 = Number()
subtraction = Subtraction(A=deconstruct_domain_5.End, B=number)
number_3 = Number(expression)
deconstuct_rectangle_4 = DeconstuctRectangle()  # -> BasePlane, XInterval, YInterval
switch_2 = Boolean(switch)
flip_locked_box = Boolean()
number_4 = Number(expression_2)
subtraction_2 = Subtraction(A=deconstruct_domain.End, B=number_3)
switch_stream = PythonScript(switch=boolean, x=number, y=subtraction)  # -> out, a
# ---------- switch_stream: Python ----------
if switch:
    a = x
else:
    a = y
# ---------- end switch_stream ----------
switch_stream_2 = PythonScript(switch=boolean, x=subtraction, y=number)  # -> out, a; same code as switch_stream
deconstruct_domain_7 = DeconstructDomain(Domain=deconstuct_rectangle_4.XInterval)  # -> Start, End
deconstruct_domain_8 = DeconstructDomain(Domain=deconstuct_rectangle_4.YInterval)  # -> Start, End
subtraction_3 = Subtraction(A=deconstruct_domain_3.End, B=number_4)
panel = Panel(switch_stream_2.a)
panel_2 = Panel(switch_stream.a)
unit_y = UnitY(Factor=number_2)
move = Move(Geometry=deconstuct_rectangle_4.BasePlane, Motion=unit_y)  # -> Geometry, Transform
subtraction_4 = Subtraction(A=deconstruct_domain_8.End, B=number_2)
switch_stream_3 = PythonScript(switch=switch_2, x=subtraction_2, y=number_3)  # -> out, a, b
# ---------- switch_stream_3: Python ----------
if switch:
    a = x
    b = y
else:
    a = y
    b = x
# ---------- end switch_stream_3 ----------
python_script = PythonScript(x=number_3, y=y)  # -> out, a
# ---------- python_script: Python ----------
if y and x==0:
    a = True
else:
    a = False
# ---------- end python_script ----------
switch_stream_4 = PythonScript(switch=flip_locked_box, x=subtraction_3, y=number_4)  # -> out, a, b; same code as switch_stream_3
rectangle_3 = Rectangle(Plane=deconstuct_rectangle_4.BasePlane, XSize=deconstruct_domain_7.End, YSize=number_2, Radius=0)  # -> Rectangle, Length
rectangle_4 = Rectangle(Plane=move.Geometry, XSize=deconstruct_domain_7.End, YSize=subtraction_4, Radius=0)  # -> Rectangle, Length
unit_y_2 = UnitY(Factor=panel_2)
python_script_2 = PythonScript(x=number_4)  # -> out, a; same code as python_script
switch_stream_5 = PythonScript(SwitchSurviver=python_script.a, x=switch_stream_3.a, y=switch_stream_3.b)  # -> out, a, b
# ---------- switch_stream_5: Python ----------
if SwitchSurviver:
    a = x
    b = y
else:
    a = y
    b = x
# ---------- end switch_stream_5 ----------
rectangle_5 = Rectangle(rectangle_3.Rectangle)
rectangle_6 = Rectangle(rectangle_4.Rectangle)
move_2 = Move(Geometry=deconstuct_rectangle_3.BasePlane, Motion=unit_y_2)  # -> Geometry, Transform
panel_3 = Panel(switch_stream_5.b)
panel_4 = Panel(switch_stream_5.a)
unit_y_3 = UnitY(Factor=panel_4)
switch_stream_6 = PythonScript(SwitchSurviver=python_script_2.a, x=switch_stream_4.a, y=switch_stream_4.b)  # -> out, a, b; same code as switch_stream_5
rectangle_7 = Rectangle(Plane=move_2.Geometry, XSize=deconstruct_domain_6.End, YSize=panel, Radius=0)  # -> Rectangle, Length
rectangle_8 = Rectangle(Plane=deconstuct_rectangle_3.BasePlane, XSize=deconstruct_domain_6.End, YSize=panel_2, Radius=0)  # -> Rectangle, Length
unit_x = UnitX(Factor=switch_stream_6.b)
move_3 = Move(Geometry=deconstuct_rectangle.BasePlane, Motion=unit_y_3)  # -> Geometry, Transform
rectangle_9 = Rectangle(rectangle_7.Rectangle)
rectangle_10 = Rectangle(rectangle_8.Rectangle)
move_4 = Move(Geometry=deconstuct_rectangle_2.BasePlane, Motion=unit_x)  # -> Geometry, Transform
panel_5 = Panel(switch_stream_6.a)
panel_6 = Panel(switch_stream_6.b)
rectangle_11 = Rectangle(Plane=move_3.Geometry, XSize=deconstruct_domain_2.End, YSize=panel_3, Radius=0)  # -> Rectangle, Length
rectangle_12 = Rectangle(Plane=deconstuct_rectangle.BasePlane, XSize=deconstruct_domain_2.End, YSize=panel_4, Radius=0)  # -> Rectangle, Length
rectangle_13 = Rectangle(Plane=move_4.Geometry, XSize=switch_stream_6.a, YSize=deconstruct_domain_4.End, Radius=0)  # -> Rectangle, Length
rectangle_14 = Rectangle(Plane=deconstuct_rectangle_2.BasePlane, XSize=switch_stream_6.b, YSize=deconstruct_domain_4.End, Radius=0)  # -> Rectangle, Length
rectangle_15 = Rectangle(rectangle_12.Rectangle)
rectangle_16 = Rectangle(rectangle_11.Rectangle)
rectangle_17 = ClusterOutput(rectangle_15)
rectangle_18 = ClusterOutput(rectangle_16)

# ==== cluster VERDIV
width = ClusterInput()
flip_locked_box = ClusterInput()
y = ClusterInput()
threshold = ClusterInput()
rectangle = ClusterInput()
rectangle_2 = Rectangle(rectangle)
# VERTICAL DIVISION
deconstuct_rectangle = DeconstuctRectangle(Rectangle=rectangle_2)  # -> BasePlane, XInterval, YInterval
deconstuct_rectangle_2 = DeconstuctRectangle()  # -> BasePlane, XInterval, YInterval
boolean = Boolean()
number = Number()
deconstruct_domain = DeconstructDomain(Domain=deconstuct_rectangle.XInterval)  # -> Start, End
deconstruct_domain_2 = DeconstructDomain(Domain=deconstuct_rectangle.YInterval)  # -> Start, End
deconstruct_domain_3 = DeconstructDomain(Domain=deconstuct_rectangle_2.XInterval)  # -> Start, End
deconstruct_domain_4 = DeconstructDomain(Domain=deconstuct_rectangle_2.YInterval)  # -> Start, End
expression = Expression(x=deconstruct_domain.End, threshold=threshold, width=width, Expression="If((threshold<x),width,0)")
number_2 = Number()
subtraction = Subtraction(A=deconstruct_domain_3.End, B=number)
# OLD
deconstuct_rectangle_3 = DeconstuctRectangle()  # -> BasePlane, XInterval, YInterval
switch_stream = PythonScript(switch=boolean, x=subtraction, y=number)  # -> out, a; same code as switch_stream
switch_stream_2 = PythonScript(switch=boolean, x=number, y=subtraction)  # -> out, a; same code as switch_stream
flip_locked_box_2 = Boolean(flip_locked_box)
number_3 = Number(expression)
deconstruct_domain_5 = DeconstructDomain(Domain=deconstuct_rectangle_3.YInterval)  # -> Start, End
panel = Panel(switch_stream.a)
deconstruct_domain_6 = DeconstructDomain(Domain=deconstuct_rectangle_3.XInterval)  # -> Start, End
panel_2 = Panel(switch_stream_2.a)
subtraction_2 = Subtraction(A=deconstruct_domain.End, B=number_3)
subtraction_3 = Subtraction(A=deconstruct_domain_6.End, B=number_2)
unit_x = UnitX(Factor=number_2)
move = Move(Geometry=deconstuct_rectangle_3.BasePlane, Motion=unit_x)  # -> Geometry, Transform
unit_x_2 = UnitX(Factor=panel_2)
switch_stream_3 = PythonScript(switch=flip_locked_box_2, x=subtraction_2, y=number_3)  # -> out, a, b; same code as switch_stream_3
rectangle_3 = Rectangle(Plane=move.Geometry, XSize=subtraction_3, YSize=deconstruct_domain_5.End, Radius=0)  # -> Rectangle, Length
rectangle_4 = Rectangle(Plane=deconstuct_rectangle_3.BasePlane, XSize=number_2, YSize=deconstruct_domain_5.End, Radius=0)  # -> Rectangle, Length
move_2 = Move(Geometry=deconstuct_rectangle_2.BasePlane, Motion=unit_x_2)  # -> Geometry, Transform
python_script = PythonScript(x=number_3, y=y)  # -> out, a; same code as python_script
rectangle_5 = Rectangle(rectangle_3.Rectangle)
rectangle_6 = Rectangle(rectangle_4.Rectangle)
rectangle_7 = Rectangle(Plane=move_2.Geometry, XSize=panel, YSize=deconstruct_domain_4.End, Radius=0)  # -> Rectangle, Length
rectangle_8 = Rectangle(Plane=deconstuct_rectangle_2.BasePlane, XSize=panel_2, YSize=deconstruct_domain_4.End, Radius=0)  # -> Rectangle, Length
switch_stream_4 = PythonScript(SwitchSurviver=python_script.a, x=switch_stream_3.a, y=switch_stream_3.b)  # -> out, a, b; same code as switch_stream_5
rectangle_9 = Rectangle(rectangle_7.Rectangle)
rectangle_10 = Rectangle(rectangle_8.Rectangle)
unit_x_3 = UnitX(Factor=switch_stream_4.b)
move_3 = Move(Geometry=deconstuct_rectangle.BasePlane, Motion=unit_x_3)  # -> Geometry, Transform
panel_3 = Panel(switch_stream_4.a)
panel_4 = Panel(switch_stream_4.b)
rectangle_11 = Rectangle(Plane=move_3.Geometry, XSize=switch_stream_4.a, YSize=deconstruct_domain_2.End, Radius=0)  # -> Rectangle, Length
rectangle_12 = Rectangle(Plane=deconstuct_rectangle.BasePlane, XSize=switch_stream_4.b, YSize=deconstruct_domain_2.End, Radius=0)  # -> Rectangle, Length
rectangle_13 = ClusterOutput(rectangle_11.Rectangle)
rectangle_14 = ClusterOutput(rectangle_12.Rectangle)
